# Grasshopper definition Ljson_components.gh (Grasshopper 1.0.8)
# plug-ins: GrasshopperSever

# 基本数据类型
panel = Panel("带时间、name标签的json数据")
series = Series(Start=0, Step=1, Count=10)  # -> graft(Series)
panel_2 = Panel("""数据1
数据2
测试1
测试2""")
j2l = Json2Ljson(String="消息")
lj = Ljson("消息")
concat = Concatenate(FragmentA="数据", FragmentB=series)
panel_3 = Panel("构造数据")
l2j = Ljson2Json(Ljson=j2l)
merge = Merge(Data1=concat, Data2=series)
st2q = DataTreeLjson(Name="test", Info="测试消息", DataTree=graft(panel_2))
st2q_2 = DataTreeLjson(Name="test", Info="测试消息", DataTree=merge)
panel_5 = Panel(l2j)
panel_6 = Panel(lj)
l2j_2 = Ljson2Json(Ljson=st2q)
l2j_3 = Ljson2Json(Ljson=st2q_2)
fj = FindJdata(Ljson=st2q_2, Name="数据2")  # -> Data, DataList
fj_2 = FindJdata(Ljson=st2q_2, Name="数据90")  # -> Data, DataList
panel_7 = Panel(st2q)
panel_8 = Panel(l2j_2)
panel_9 = Panel(st2q_2)
panel_10 = Panel(l2j_3)
panel_11 = Panel(fj.Data)
panel_12 = Panel(fj_2.Data)
