# Grasshopper definition scripteditor_test2.gh (Grasshopper 1.0.8)
# plug-ins: GrasshopperSever

c_script = CSharpScript()  # -> out, a; inputs y99: String, z: Complex
# ---------- c_script: C# ----------
// Grasshopper Script Instance
#region Usings
using System;
using System.Linq;
using System.Collections;
using System.Collections.Generic;
using System.Drawing;

using Rhino;
using Rhino.Geometry;

using Grasshopper;
using Grasshopper.Kernel;
using Grasshopper.Kernel.Data;
using Grasshopper.Kernel.Types;
#endregion

public class Script_Instance : GH_ScriptInstance
{
    #region Notes
    /* 
      Members:
        RhinoDoc RhinoDocument
        GH_Document GrasshopperDocument
        IGH_Component Component
        int Iteration

      Methods (Virtual & overridable):
        Print(string text)
        Print(string format, params object[] args)
        Reflect(object obj)
        Reflect(object obj, string method_name)
    */
    #endregion

    private void RunScript(
		object x,
		string y99,
		System.Numerics.Complex z,
		ref object a)
    {
        // Write your logic here
        a = null;
    }
}
# ---------- end c_script ----------
panel = Panel("""// GH_COMPONENT_IO_START
// INPUT_PARAMS: [{    "typeHintID": "b2ea84da-7a94-4144-9f7a-63167abd77e3",    "typeHintName": "Point3dList",    "showTypeHints": true,    "allowTreeAccess": true,    "toolTip": "",    "scriptParamAccess": 0,    "variableName": "x",    "prettyName": "x",    "optional": true,    "hidden": false,    "description": "Converts to collection of three-dimensional points.\nPrimarily to convert Polyline into list of points to match legacy GHPython behaviour.\nThis is only supported in Rhino >= 8.7",    "castTargetType": null},{    "typeHintID": "6a184b65-baa3-42d1-a548-3915b401de53",    "typeHintName": "No Type Hint",    "showTypeHints": true,    "allowTreeAccess": true,    "toolTip": "",    "scriptParamAccess": 0,    "variableName": "y",    "prettyName": "y",    "optional": true,    "hidden": false,    "description": "No conversion",    "castTargetType": null},{    "typeHintID": "19ff81a2-dc4f-4035-8de9-26224c561321",    "typeHintName": "double",    "showTypeHints": true,    "allowTreeAccess": true,    "toolTip": "",    "scriptParamAccess": 0,    "variableName": "z",    "prettyName": "z",    "optional": true,    "hidden": false,    "description": "Converts to collection of floating point numbers",    "castTargetType": null},{    "typeHintID": "09bcf900-fe83-4efa-8d32-33d89f7a3e66",    "typeHintName": "DateTime",    "showTypeHints": true,    "allowTreeAccess": true,    "toolTip": "",    "scriptParamAccess": 1,    "variableName": "u",    "prettyName": "u",    "optional": true,    "hidden": false,    "description": "Converts to collection of date time format strings",    "castTargetType": null}]
// OUTPUT_PARAMS: [{    "typeHintID": "6a184b65-baa3-42d1-a548-3915b401de53",    "typeHintName": "No Type Hint",    "showTypeHints": true,    "allowTreeAccess": false,    "toolTip": "",    "scriptParamAccess": 0,    "variableName": "a",    "prettyName": "a",    "optional": false,    "hidden": false,    "description": "No conversion",    "castTargetType": null},{    "typeHintID": "6a184b65-baa3-42d1-a548-3915b401de53",    "typeHintName": "No Type Hint",    "showTypeHints": true,    "allowTreeAccess": false,    "toolTip": "",    "scriptParamAccess": 0, "variableName": "b",    "prettyName": "b",    "optional": false,    "hidden": false,    "description": "No conversion",    "castTargetType": null},{    "typeHintID": "6a184b65-baa3-42d1-a548-3915b401de53",    "typeHintName": "No Type Hint",    "showTypeHints": true,    "allowTreeAccess": false,    "toolTip": "",    "scriptParamAccess": 0,    "variableName": "c",    "prettyName": "c",    "optional": false,    "hidden": false,    "description": "No conversion",    "castTargetType": null}]
// GH_COMPONENT_IO_END
// Grasshopper Script Instance
#region Usings
using System;
using System.Linq;
using System.Collections;
using System.Collections.Generic;
using System.Drawing;

using Rhino;
using Rhino.Geometry;

using Grasshopper;
using Grasshopper.Kernel;
using Grasshopper.Kernel.Data;
using Grasshopper.Kernel.Types;
#endregion

public class Script_Instance : GH_ScriptInstance
{
    #region Notes
    /* 
      Members:
        RhinoDoc RhinoDocument
        GH_Document GrasshopperDocument
        IGH_Component Component
        int Iteration

      Methods (Virtual & overridable):
        Print(string text)
        Print(string format, params object[] args)
        Reflect(object obj)
        Reflect(object obj, string method_name)
    */
    #endregion

    private void RunScript(
    object x,
    object y,
    double z,
    List<DateTime> u,
    ref object a,
    ref object b,
    ref object c)
    {
        // Write your logic here
        a = null;
    }
}""")
# 通过字符串修改输入端、输出端
script = ScriptEditor(ScriptComponent=c_script.out)  # -> Result, ComponentType, IsSDKMode, SourceCode, InputParams, OutputParams
# 通过代码修改输入端、输出端
c_script_2 = CSharpScript()  # -> out, a, b, c; inputs z: Double, u: list of DateTime
# ---------- c_script_2: C# ----------
// GH_COMPONENT_IO_START
// INPUT_PARAMS: [{    "typeHintID": "b2ea84da-7a94-4144-9f7a-63167abd77e3",    "typeHintName": "Point3dList",    "showTypeHints": true,    "allowTreeAccess": true,    "toolTip": "",    "scriptParamAccess": 0,    "variableName": "x",    "prettyName": "x",    "optional": true,    "hidden": false,    "description": "Converts to collection of three-dimensional points.\nPrimarily to convert Polyline into list of points to match legacy GHPython behaviour.\nThis is only supported in Rhino >= 8.7",    "castTargetType": null},{    "typeHintID": "6a184b65-baa3-42d1-a548-3915b401de53",    "typeHintName": "No Type Hint",    "showTypeHints": true,    "allowTreeAccess": true,    "toolTip": "",    "scriptParamAccess": 0,    "variableName": "y",    "prettyName": "y",    "optional": true,    "hidden": false,    "description": "No conversion",    "castTargetType": null},{    "typeHintID": "19ff81a2-dc4f-4035-8de9-26224c561321",    "typeHintName": "double",    "showTypeHints": true,    "allowTreeAccess": true,    "toolTip": "",    "scriptParamAccess": 0,    "variableName": "z",    "prettyName": "z",    "optional": true,    "hidden": false,    "description": "Converts to collection of floating point numbers",    "castTargetType": null},{    "typeHintID": "09bcf900-fe83-4efa-8d32-33d89f7a3e66",    "typeHintName": "DateTime",    "showTypeHints": true,    "allowTreeAccess": true,    "toolTip": "",    "scriptParamAccess": 1,    "variableName": "u",    "prettyName": "u",    "optional": true,    "hidden": false,    "description": "Converts to collection of date time format strings",    "castTargetType": null}]
// OUTPUT_PARAMS: [{    "typeHintID": "6a184b65-baa3-42d1-a548-3915b401de53",    "typeHintName": "No Type Hint",    "showTypeHints": true,    "allowTreeAccess": false,    "toolTip": "",    "scriptParamAccess": 0,    "variableName": "a",    "prettyName": "a",    "optional": false,    "hidden": false,    "description": "No conversion",    "castTargetType": null},{    "typeHintID": "6a184b65-baa3-42d1-a548-3915b401de53",    "typeHintName": "No Type Hint",    "showTypeHints": true,    "allowTreeAccess": false,    "toolTip": "",    "scriptParamAccess": 0, "variableName": "b",    "prettyName": "b",    "optional": false,    "hidden": false,    "description": "No conversion",    "castTargetType": null},{    "typeHintID": "6a184b65-baa3-42d1-a548-3915b401de53",    "typeHintName": "No Type Hint",    "showTypeHints": true,    "allowTreeAccess": false,    "toolTip": "",    "scriptParamAccess": 0,    "variableName": "c",    "prettyName": "c",    "optional": false,    "hidden": false,    "description": "No conversion",    "castTargetType": null}]
// GH_COMPONENT_IO_END
// Grasshopper Script Instance
#region Usings
using System;
using System.Linq;
using System.Collections;
using System.Collections.Generic;
using System.Drawing;

using Rhino;
using Rhino.Geometry;

using Grasshopper;
using Grasshopper.Kernel;
using Grasshopper.Kernel.Data;
using Grasshopper.Kernel.Types;
#endregion

public class Script_Instance : GH_ScriptInstance
{
    #region Notes
    /* 
      Members:
        RhinoDoc RhinoDocument
        GH_Document GrasshopperDocument
        IGH_Component Component
        int Iteration

      Methods (Virtual & overridable):
        Print(string text)
        Print(string format, params object[] args)
        Reflect(object obj)
        Reflect(object obj, string method_name)
    */
    #endregion

    private void RunScript(
		object x,
		object y,
		double z,
		List<DateTime> u,
		ref object a,
		ref object b,
		ref object c)
    {
        // Write your logic here
        a = null;
    }
}
# ---------- end c_script_2 ----------
panel_2 = Panel(script.InputParams)
py3 = Python3Script()  # -> out
# ---------- py3: Python ----------
# GH_COMPONENT_IO_START
# INPUT_PARAMS: [{    "typeHintID": "6a184b65-baa3-42d1-a548-3915b401de53",    "typeHintName": "No Type Hint",    "showTypeHints": true,    "allowTreeAccess": true,    "toolTip": "",    "scriptParamAccess": 0,    "variableName": "x",    "prettyName": "x",    "optional": true,    "hidden": false,    "description": "No conversion",    "castTargetType": null  },{    "typeHintID": "9e93878a-f9c5-4f0a-8a70-584bf09f24bb",    "typeHintName": "string",    "showTypeHints": true,    "allowTreeAccess": true,    "toolTip": "",    "scriptParamAccess": 0,    "variableName": "y99",    "prettyName": "y99",    "optional": true,    "hidden": false,    "description": "Converts to collection of text fragments",    "castTargetType": null  },{    "typeHintID": "309690df-6229-4774-91bb-b1c9c0bfa54d",    "typeHintName": "Complex",    "showTypeHints": true,    "allowTreeAccess": true,    "toolTip": "",    "scriptParamAccess": 0,    "variableName": "z",    "prettyName": "z",    "optional": true,    "hidden": false,    "description": "Converts to collection of complex numbers",    "castTargetType": null  }]
# OUTPUT_PARAMS: 
# GH_COMPONENT_IO_END
# ---------- end py3 ----------
c_script_3 = CSharpScript()  # -> out
# ---------- c_script_3: C# ----------
// GH_COMPONENT_IO_START
// INPUT_PARAMS: [{    "typeHintID": "6a184b65-baa3-42d1-a548-3915b401de53",    "typeHintName": "No Type Hint",    "showTypeHints": true,    "allowTreeAccess": true,    "toolTip": "",    "scriptParamAccess": 0,    "variableName": "x",    "prettyName": "x",    "optional": true,    "hidden": false,    "description": "No conversion",    "castTargetType": null  },{    "typeHintID": "9e93878a-f9c5-4f0a-8a70-584bf09f24bb",    "typeHintName": "string",    "showTypeHints": true,    "allowTreeAccess": true,    "toolTip": "",    "scriptParamAccess": 0,    "variableName": "y99",    "prettyName": "y99",    "optional": true,    "hidden": false,    "description": "Converts to collection of text fragments",    "castTargetType": null  },{    "typeHintID": "309690df-6229-4774-91bb-b1c9c0bfa54d",    "typeHintName": "Complex",    "showTypeHints": true,    "allowTreeAccess": true,    "toolTip": "",    "scriptParamAccess": 0,    "variableName": "z",    "prettyName": "z",    "optional": true,    "hidden": false,    "description": "Converts to collection of complex numbers",    "castTargetType": null  }]
// OUTPUT_PARAMS: 
// GH_COMPONENT_IO_END
# ---------- end c_script_3 ----------
script_2 = ScriptEditor(ScriptComponent=c_script_2.out, Code=panel)  # -> Result, ComponentType, IsSDKMode, SourceCode, InputParams, OutputParams
script_3 = ScriptEditor(ScriptComponent=py3, IntputParams=panel_2)  # -> Result, ComponentType, IsSDKMode, SourceCode, InputParams, OutputParams
script_4 = ScriptEditor(ScriptComponent=c_script_3, IntputParams=panel_2)  # -> Result, ComponentType, IsSDKMode, SourceCode, InputParams, OutputParams
panel_3 = Panel(script_4.SourceCode)
# 通过代码修改输入端、输出端
c_script_4 = CSharpScript()  # -> out; same code as c_script_3
script_5 = ScriptEditor(ScriptComponent=c_script_4, Code=panel_3)  # -> Result, ComponentType, IsSDKMode, SourceCode, InputParams, OutputParams
