# Grasshopper definition scripteditor_test3.gh (Grasshopper 1.0.8)
# plug-ins: GrasshopperSever

panel = Panel("""using System.Text.Json;
using Grasshopper;
using GrasshopperSever.Utils;

public class Script_Instance : GH_ScriptInstance
{
    private void RunScript(ref object ljson)
    {
        string json = "{\"name\":\"张三\",\"age\":30}";
        using (var doc = JsonDocument.Parse(json)){
            JsonElement root = doc.RootElement.Clone();
            ljson = new Ljson("TEST", "TEST INFO", root);
        }
    }
}""")
panel_2 = Panel("""string json = "{\"Name\":\"Test\", \"Value\": {\"name\":\"张三2\",\"age\":30}}";
LJ = new Ljson(json);""")
panel_3 = Panel("""string json = "{\"name\":\"张三\",\"age\":30}";
using (var doc = JsonDocument.Parse(json)){
    JsonElement root = doc.RootElement.Clone();
    LJ = new Ljson("TEST", "TEST INFO", root);
}""")
runc_2 = RunScript2(
    C=panel_2,
    Reference=["D:\Program\CAD开发\Rhino\rhino&grasshopper mcp\GrasshopperSever\bin\Release\net7.0-windows\GrasshopperSever.gha", "D:\Program\CAD开发\Rhino\rhino&grasshopper mcp\GrasshopperSever\bin\Release\net7.0-windows\GrasshopperSever.gha", "D:\Program\CAD开发\Rhino\rhino&grasshopper mcp\GrasshopperSever\bin\Release\net7.0-windows\GrasshopperSever.gha", "D:\Program\CAD开发\Rhino\rhino&grasshopper mcp\GrasshopperSever\bin\Release\net7.0-windows\GrasshopperSever.gha", "D:\Program\CAD开发\Rhino\rhino&grasshopper mcp\GrasshopperSever\bin\Release\net7.0-windows\GrasshopperSever.gha", "D:\Program\CAD开发\Rhino\rhino&grasshopper mcp\GrasshopperSever\bin\Release\net7.0-windows\GrasshopperSever.gha"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])  # -> O, LJ
# ---------- runc_2: C# usings ----------
using GrasshopperSever.Utils; using System.Data.SQLite;
# ---------- runc_2: C# ----------
string json = "{\"Name\":\"Test\", \"Value\": {\"name\":\"张三2\",\"age\":30}}";
LJ = new Ljson(json);
# ---------- end runc_2 ----------
runc_2_2 = RunScript2(
    C=panel_3,
    U="using System.Text.Json;",
    Reference=["D:\Program\CAD开发\Rhino\rhino&grasshopper mcp\GrasshopperSever\bin\Release\net7.0-windows\GrasshopperSever.gha", "D:\Program\CAD开发\Rhino\rhino&grasshopper mcp\GrasshopperSever\bin\Release\net7.0-windows\GrasshopperSever.gha", "D:\Program\CAD开发\Rhino\rhino&grasshopper mcp\GrasshopperSever\bin\Release\net7.0-windows\GrasshopperSever.gha", "D:\Program\CAD开发\Rhino\rhino&grasshopper mcp\GrasshopperSever\bin\Release\net7.0-windows\GrasshopperSever.gha", "D:\Program\CAD开发\Rhino\rhino&grasshopper mcp\GrasshopperSever\bin\Release\net7.0-windows\GrasshopperSever.gha", "D:\Program\CAD开发\Rhino\rhino&grasshopper mcp\GrasshopperSever\bin\Release\net7.0-windows\GrasshopperSever.gha"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])  # -> O, LJ
# ---------- runc_2_2: C# usings ----------
using GrasshopperSever.Utils; using System.Data.SQLite;using System.Text.Json;
# ---------- runc_2_2: C# ----------
string json = "{\"name\":\"张三\",\"age\":30}";
using (var doc = JsonDocument.Parse(json)){
    JsonElement root = doc.RootElement.Clone();
    LJ = new Ljson("TEST", "TEST INFO", root);
}
# ---------- end runc_2_2 ----------
runc = RunScript(Code=panel)  # -> Out, Ljson
l2j = Ljson2Json(Ljson=runc.Ljson)
l2j_2 = Ljson2Json(Ljson=runc_2.LJ)
l2j_3 = Ljson2Json(Ljson=runc_2_2.LJ)
panel_4 = Panel(l2j)
panel_5 = Panel(l2j_3)
panel_6 = Panel(l2j_2)
