# Grasshopper definition 逻辑大师-GH趣味案例集第六季-29-DNA螺线.gh (Grasshopper 1.0.8)
# plug-ins: Hare

pi = Pi(Factor=Slider(2, range=0..10))
cir = Circle(Plane=PlaneXY(0, 0, 0), Radius=Slider(100, range=0..100))
range = Range(Domain=pi, Steps=Slider(3, range=0..10))
helix = Helix(RoundCount=Slider(5, range=0..10), LengthCurve=cir, Angle=range, Radius=Slider(12.34, range=0..100))  # -> Spiral, GuideCurve
pipe = Pipe(Curve=helix.Spiral, Radius=Slider(3.95, range=0..10), Caps=0, FitRail=False)
