# Grasshopper definition python_script.gh (Grasshopper 1.0.8)
# plug-ins: GrasshopperSever

num1 = Slider(0.1, range=0..0.1)
num2 = Slider(100, range=0..100)
series1 = Series(Start=0, Step=num1, Count=num2)
series2 = Series(Start=0, Step=num1, Count=num2)
py3 = Python3Script(xs=series1, ys=series2)  # -> out, surface; inputs xs: list, ys: list
# ---------- py3: Python ----------
# GH_COMPONENT_IO_START
# INPUT_PARAMS: [{"typeHintName": "float", "scriptParamAccess": 1, "variableName": "xs"},{"typeHintName": "float", "scriptParamAccess": 1, "variableName": "ys"}]
# OUTPUT_PARAMS: [{"typeHintName": "ghdoc Object", "variableName": "surface"}]
# GH_COMPONENT_IO_END

import rhinoscriptsyntax as rs
import math

# ======== 自定义数学函数 ========
def f(x, y):
    # 示例：正弦余弦组合曲面（可自行修改）
    return math.sin(x) * math.cos(y)

# ======== 主逻辑 ========
if xs is None or ys is None:
    surface = None
    print("输入无效：xs 或 ys 为空")
else:
    # 确保 xs 和 ys 被转换为列表（兼容 Grasshopper 数据树）
    if hasattr(xs, 'ToList'):
        xs = xs.ToList()
    if hasattr(ys, 'ToList'):
        ys = ys.ToList()
    
    # 生成点阵（按网格顺序：固定 y，遍历 x）
    points = []
    for y in ys:
        for x in xs:
            z = f(x, y)
            points.append((x, y, z))
    
    # 通过点阵创建 Nurbs 曲面
    points_2d = []
    for y in ys:
        for x in xs:
            z = f(x, y)
            points_2d.append((x, y, z))
    srf = rs.AddSrfPtGrid((len(xs), len(ys)), points_2d)
    surface = rs.coercegeometry(srf)
# ---------- end py3 ----------
server = GHServer(Enabled="true", Port="5695")  # -> Status, OutPut
script = ScriptEditor(ScriptComponent=py3.out, Code=server.OutPut)  # -> Result, ComponentType, IsSDKMode, SourceCode, InputParams, OutputParams
panel1 = Panel(py3.surface)
