# Grasshopper definition run_script.gh (Grasshopper 1.0.8)
# plug-ins: GrasshopperSever, SimpleTools

half = Half(X=0)
receiver = GHReceiver(Enabled="true", Port="5695")  # -> Client, LJson, Status
actuator = GHActuator(LJson=receiver.LJson)  # -> Status, Result, OutPut
multiplication = Multiplication()
runc = RunScript(Code=actuator.OutPut)  # -> Out, Ljson
pl = ConstructPlane(Origin=Point(0, 0, 0), XAxis=Vector(1, 0, 0), YAxis=Vector(0, 1, 0))
sender = GHSender(Client=receiver.Client, LJson=runc.Ljson)
