# Grasshopper definition scripteditor.gh (Grasshopper 1.0.8)
# plug-ins: GrasshopperSever

server = GHServer(Enabled="true", Port="6879")  # -> Status, OutPut
py3 = Python3Script()  # -> out, a; unedited script template
actuator = GHActuator()  # -> Status, Result, OutPut
script = ScriptEditor(ScriptComponent=py3.out, Code=server.OutPut)  # -> Result, ComponentType, IsSDKMode, SourceCode, InputParams, OutputParams
panel = Panel(script.ComponentType)
