# Grasshopper definition 曲线干扰.gh (Grasshopper 1.0.8)
# plug-ins: GrasshopperSever

panel2 = Panel("-5 to 5")
radiusnum = Slider(2.8, range=0..10)
rect1 = Rectangle(Plane=PlaneXY(0, 0, 0), XSize=panel2, YSize=panel2, Radius=0)  # -> Rectangle, Length
server = GHServer(Enabled="true", Port="6879")  # -> Status, OutPut
circlecurve = Circle(Plane=PlaneXY(0, 0, 0), Radius=radiusnum)
pop2d = Populate2D(Region=rect1.Rectangle, Count=Slider(622, range=0..1000), Seed=1)
crv_cp = CurveClosestPoint(Point=pop2d, Curve=circlecurve)  # -> Point, Parameter, Distance
panel1 = Panel("0.1 to 0.2")
bounds1 = Bounds(Numbers=crv_cp.Distance)
remap1 = RemapNumbers(Value=crv_cp.Distance, Source=bounds1, Target=panel1)  # -> Mapped, Clipped
circlegen = Circle(Plane=pop2d, Radius=remap1.Mapped)
