# Grasshopper definition 渐变穿孔板.gh (Grasshopper 1.0.8)

# 将基础面切割
crv = Curve(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)
line = Line([Line((-8100, 17480, 0), (5240.000001, 17480, 0)), Line((-8100, 16430, 0), (5240.000001, 16430, 0)), Line((-3159.999999, 15380, 0), (-3159.999999, 18530, 0)), Line((1040.000001, 15380, 0), (1040.000001, 18530, 0))])
参考点 = Point(Point(-8392.5, 15397.5, 0))
srf = Surface(crv)
line_2 = Line(line)
pt = Point(参考点)
srf_2 = Surface(srf)
srfsplit = SurfaceSplit(Surface=srf, Curves=line_2)
# 找到面左下角一点
# 建立35*35的网格
bbox = BoundingBox(Content=srf_2, Plane=PlaneXY(0, 0, 0), UnionBox=True)  # -> Box, Box_2
dim = Dimensions(Surface=bbox.Box)  # -> UDimension, VDimension
# 将边框和定位点从下到上，左到右排序
边框 = Curve(srfsplit)
area = Area(Geometry=srfsplit)  # -> Area, Centroid
# 找到在曲面范围内的点
ipy2 = IronPython2Script(origin=pt, xz=dim.UDimension, yz=dim.VDimension, cell="35")  # -> points; inputs origin: Point3d, xz: Double, yz: Double, cell: Double
# ---------- ipy2: IronPython ----------
import Rhino.Geometry as geo

ori = origin - geo.Point3d(cell/2, cell/2, 0)
points= []
for i in range(int(xz/cell)+15):
    for j in range(int(yz/cell)+15):
        points.append(ori + geo.Point3d(i* cell, j*cell, 0))
# ---------- end ipy2 ----------
ipy2_2 = IronPython2Script(origin=pt, pts=area.Centroid)  # -> indices, corners; inputs origin: Point3d, pts: list of Point3d
# ---------- ipy2_2: IronPython ----------
import rhinoscriptsyntax as rs
import Rhino.Geometry as rg

cell_width = 4200
cell_height = 1050

results = []  # 存储结果 (左下角坐标, 原始索引)

for idx, pt in enumerate(pts):
    dx = pt.X - origin.X
    dy = pt.Y - origin.Y
    i = int(dx / cell_width)
    j = int(dy / cell_height)
    cell_corner = rg.Point3d(
        origin.X + i * cell_width,
        origin.Y + j * cell_height,
        origin.Z
    )
    results.append((cell_corner, idx))

sorted_results = sorted(results, key=lambda x: (x[0].X, x[0].Y))

corners = [item[0] for item in sorted_results]
indices = [item[1] for item in sorted_results]
# ---------- end ipy2_2 ----------
incurve = PointInCurve(Point=ipy2, Curve=srf_2)  # -> Relationship, Point
dispatch = Dispatch(List=incurve.Point, DispatchPattern=incurve.Relationship)  # -> ListA, ListB
item = ListItem(List=边框, Index=ipy2_2.indices, Wrap=True)
srf_cp = SurfaceClosestPoint(Point=dispatch.ListA, Surface=reparameterize(srf_2))  # -> Point, UVPoint, Distance
# 对范围内的点进行干扰，创建圆形
image = ImageSampler(srf_cp.UVPoint, Filter="Value", Interpolate=True, Umax=1, Umin=0, Vmax=1, Vmin=0, Wrap=1)
offset = OffsetCurve(Curve=item, Distance="-26", Corners=1)  # -> flatten(Curve)
# 这里为孔的最大和最小半径
panel = Panel("5")
dom = ConstructDomain(DomainStart="15", DomainEnd=panel)
bnd = Bounds(Numbers=image)
# 按照每个小面对点进行分组
lng = ListLength(List=item)
incurves = PointInCurves(Point=dispatch.ListA, Curves=offset)  # -> Relationship, Index, Point
remap = RemapNumbers(Value=image, Source=bnd, Target=dom)  # -> Mapped, Clipped
int = Integer(remap.Mapped)
cir = Circle(Plane=srf_cp.Point, Radius=int)
ipy2_3 = IronPython2Script(ll=lng, idxes=incurves.Index, circles=cir)  # -> tree; inputs ll: Int32, idxes: list of Int32, circles: list
# ---------- ipy2_3: IronPython ----------
import ghpythonlib.treehelpers as th

data = [[] for _ in range(ll)]

for i in range(len(idxes)):
    d_i = idxes[i]
    if d_i < 0: continue
    data[d_i].append(circles[i])

tree = th.list_to_tree(data)
# ---------- end ipy2_3 ----------
merge = Merge(Data1=simplify(graft(item)), Data2=simplify(ipy2_3))
group = Group(Objects=merge)  # -> flatten(Group)
