# Grasshopper definition scripteditor_test.gh (Grasshopper 1.0.8)
# plug-ins: GrasshopperSever

# 这里需要传入一个{“OUTPUT”: Code}
panel = Panel("""这个例子是使用api操作script组件
无回复版""")
panel_2 = Panel("""这个例子是使用api操作script组件
简化流程版""")
panel_3 = Panel("这个例子是使用api操作script组件")
# True To Make Run
toggle = BooleanToggle(False)
# True To Make Run
toggle_2 = BooleanToggle(False)
# 这里键自定义
# 要和api输入一致
panel_4 = Panel("Code")
receiver = GHReceiver(Enabled=toggle, Port="6895")  # -> Client, Json, Status
txt = Text(panel_4)
receiver_2 = GHReceiver(Enabled=toggle_2, Port="6896")  # -> Client, Json, Status
py3 = Python3Script()  # -> out, a; unedited script template
c_script = CSharpScript()  # -> out, a
# ---------- c_script: C# ----------
// GH_COMPONENT_IO_START
// INPUT_PARAMS: {"Time":"2026-03-26T16:49:43.9194113+08:00","Items":[{"Name":"Param","Info":"参数信息","Time":"2026-03-26T16:49:43.9194086+08:00","Value":{"ParamGuid":"08908df5-fa14-4982-9ab2-1aa0927566aa","InstanceGuid":"ea12c153-f58c-4f45-a692-2333912f9cf4","Name":"x","NickName":"x","Description":"No conversion","TypeName":"Generic Data","Optional":true,"Access":"item","Mapping":"None","Reverse":false,"Simplify":false,"Inputs":"[]","Outputs":"[]"}},{"Name":"Param","Info":"参数信息","Time":"2026-03-26T16:49:43.9194112+08:00","Value":{"ParamGuid":"08908df5-fa14-4982-9ab2-1aa0927566aa","InstanceGuid":"6302ae58-14d0-41aa-ba87-04877dffd153","Name":"y","NickName":"y","Description":"No conversion","TypeName":"Generic Data","Optional":true,"Access":"item","Mapping":"None","Reverse":false,"Simplify":false,"Inputs":"[]","Outputs":"[]"}}]}
// OUTPUT_PARAMS: {"Time":"2026-03-26T16:49:43.9194249+08:00","Items":[{"Name":"Param","Info":"参数信息","Time":"2026-03-26T16:49:43.9194222+08:00","Value":{"ParamGuid":"3ede854e-c753-40eb-84cb-b48008f14fd4","InstanceGuid":"d2ed951e-b88c-40e3-afdd-e14defd3dacb","Name":"out","NickName":"out","Description":"Standard output and error contents collected during script run","TypeName":"Text","Optional":false,"Access":"item","Mapping":"None","Reverse":false,"Simplify":false,"Inputs":"[]","Outputs":"[\"d2f4aff6-0bfe-451e-a21f-9d3e87a14327\"]"}},{"Name":"Param","Info":"参数信息","Time":"2026-03-26T16:49:43.9194248+08:00","Value":{"ParamGuid":"08908df5-fa14-4982-9ab2-1aa0927566aa","InstanceGuid":"19ceb959-68cd-4c9a-8afe-dc13d307012b","Name":"a","NickName":"a","Description":"No conversion","TypeName":"Generic Data","Optional":false,"Access":"item","Mapping":"None","Reverse":false,"Simplify":false,"Inputs":"[]","Outputs":"[]"}}]}
// GH_COMPONENT_IO_END
// Grasshopper Script Instance
#region Usings
using System;
using System.Linq;
using System.Collections;
using System.Collections.Generic;
using System.Drawing;

using Rhino;
using Rhino.Geometry;

using Grasshopper;
using Grasshopper.Kernel;
using Grasshopper.Kernel.Data;
using Grasshopper.Kernel.Types;
#endregion

public class Script_Instance : GH_ScriptInstance
{
    #region Notes
    /* 
      Members:
        RhinoDoc RhinoDocument
        GH_Document GrasshopperDocument
        IGH_Component Component
        int Iteration

      Methods (Virtual & overridable):
        Print(string text)
        Print(string format, params object[] args)
        Reflect(object obj)
        Reflect(object obj, string method_name)
    */
    #endregion

    private void RunScript(object x, object y, ref object a)
    {
        // 创建一个点
        Rhino.Geometry.Point3d point = new Rhino.Geometry.Point3d(10.0, 20.0, 30.0);
        
        // 返回点
        a = point;
    }
}
# ---------- end c_script ----------
c_script_2 = CSharpScript()  # -> out, a; same code as c_script
server = GHServer(Enabled=Toggle(False), Port="6897")  # -> Status, OutPut
fj = FindJdata(Ljson=receiver.Json, Name=txt)  # -> Data, DataList
c_script_3 = CSharpScript()  # -> out, a; same code as c_script
actuator = GHActuator(LJson=receiver_2.Json)  # -> Status, Result, OutPut
script = ScriptEditor(ScriptComponent=c_script.out, Code=fj.Data)  # -> Result, ComponentType, IsSDKMode, SourceCode, InputParams, OutputParams
script_2 = ScriptEditor(ScriptComponent=c_script_2.out, Code=actuator.OutPut)  # -> Result, ComponentType, IsSDKMode, SourceCode, InputParams, OutputParams
script_3 = ScriptEditor(ScriptComponent=c_script_3.out, Code=server.OutPut)  # -> Result, ComponentType, IsSDKMode, SourceCode, InputParams, OutputParams
# 这里组合返回的数据
panel_5 = Panel("SCRIPTRESULT")
merge = Merge(Data1=txt, Data2=flatten(script.SourceCode))
# 这里组合返回的数据
sender = GHSender(Client=receiver_2.Client, Json=script_2.SourceCode)
st2q = StringTreeLjson(Name=panel_5, Info=panel_5, DataTree=merge)
sender_2 = GHSender(Client=receiver.Client, Json=st2q)
