# Grasshopper definition scripteditor_test2.gh (Grasshopper 1.0.8)
# plug-ins: GrasshopperSever

panel = Panel("""// GH_COMPONENT_IO_START
// INPUT_PARAMS: [{"ParamGuid":"08908df5-fa14-4982-9ab2-1aa0927566aa","InstanceGuid":"464db661-b61f-425b-b670-8154dff47ccf","Name":"x","NickName":"x","Description":"No conversion","TypeName":"Generic Data","Optional":true,"Access":"item","Mapping":"None","Reverse":false,"Simplify":false,"Inputs":"[]","Outputs":"[]"},{"ParamGuid":"08908df5-fa14-4982-9ab2-1aa0927566aa","InstanceGuid":"e6a253f8-f778-4eb4-9d22-d95505902565","Name":"y","NickName":"y","Description":"No conversion","TypeName":"Generic Data","Optional":true,"Access":"item","Mapping":"None","Reverse":false,"Simplify":false,"Inputs":"[]","Outputs":"[]"},{"ParamGuid":"08908df5-fa14-4982-9ab2-1aa0927566aa","InstanceGuid":"636c3c65-f4f5-488e-a33d-fa902cef1cec","Name":"z","NickName":"z","Description":"No conversion","TypeName":"Generic Data","Optional":true,"Access":"item","Mapping":"None","Reverse":false,"Simplify":false,"Inputs":"[]","Outputs":"[]"},{"ParamGuid":"08908df5-fa14-4982-9ab2-1aa0927566aa","InstanceGuid":"dc0849be-e683-4828-af61-3bc86eeda406","Name":"u","NickName":"u","Description":"No conversion","TypeName":"Generic Data","Optional":true,"Access":"item","Mapping":"None","Reverse":false,"Simplify":false,"Inputs":"[]","Outputs":"[]"}]
// OUTPUT_PARAMS: [{"ParamGuid":"3ede854e-c753-40eb-84cb-b48008f14fd4","InstanceGuid":"7ad1b6fa-ef90-4160-b5bd-e15b2496793d","Name":"out","NickName":"out","Description":"Standard output and error contents collected during script run","TypeName":"Text","Optional":false,"Access":"item","Mapping":"None","Reverse":false,"Simplify":false,"Inputs":"[]","Outputs":"[\u0022bd8ea2a9-eabb-4c1d-b23c-8cd43031e2aa\u0022]"},{"ParamGuid":"08908df5-fa14-4982-9ab2-1aa0927566aa","InstanceGuid":"0ed9ac1a-e4c4-40cc-8a51-39c576619024","Name":"a","NickName":"a","Description":"No conversion","TypeName":"Generic Data","Optional":false,"Access":"item","Mapping":"None","Reverse":false,"Simplify":false,"Inputs":"[]","Outputs":"[]"}]
// GH_COMPONENT_IO_END
// Grasshopper Script Instance
#region Usings
using System;
using System.Linq;
using System.Collections;
using System.Collections.Generic;
using System.Drawing;

using Rhino;
using Rhino.Geometry;

using Grasshopper;
using Grasshopper.Kernel;
using Grasshopper.Kernel.Data;
using Grasshopper.Kernel.Types;
#endregion

public class Script_Instance : GH_ScriptInstance
{
    #region Notes
    /* 
      Members:
        RhinoDoc RhinoDocument
        GH_Document GrasshopperDocument
        IGH_Component Component
        int Iteration

      Methods (Virtual & overridable):
        Print(string text)
        Print(string format, params object[] args)
        Reflect(object obj)
        Reflect(object obj, string method_name)
    */
    #endregion

    private void RunScript(object x, object y, object z, ref object a)
    {
        // Write your logic here
        a = null;
    }
}""")
panel_2 = Panel("[{\"ParamGuid\":\"08908df5-fa14-4982-9ab2-1aa0927566aa\",\"InstanceGuid\":\"464db661-b61f-425b-b670-8154dff47ccf\",\"Name\":\"x\",\"NickName\":\"x\",\"Description\":\"No conversion\",\"TypeName\":\"Generic Data\",\"Optional\":true,\"Access\":\"item\",\"Mapping\":\"None\",\"Reverse\":false,\"Simplify\":false,\"Inputs\":\"[]\",\"Outputs\":\"[]\"},{\"ParamGuid\":\"08908df5-fa14-4982-9ab2-1aa0927566aa\",\"InstanceGuid\":\"e6a253f8-f778-4eb4-9d22-d95505902565\",\"Name\":\"y\",\"NickName\":\"y\",\"Description\":\"No conversion\",\"TypeName\":\"Generic Data\",\"Optional\":true,\"Access\":\"item\",\"Mapping\":\"None\",\"Reverse\":false,\"Simplify\":false,\"Inputs\":\"[]\",\"Outputs\":\"[]\"},{\"ParamGuid\":\"08908df5-fa14-4982-9ab2-1aa0927566aa\",\"InstanceGuid\":\"636c3c65-f4f5-488e-a33d-fa902cef1cec\",\"Name\":\"z\",\"NickName\":\"z\",\"Description\":\"No conversion\",\"TypeName\":\"Generic Data\",\"Optional\":true,\"Access\":\"item\",\"Mapping\":\"None\",\"Reverse\":false,\"Simplify\":false,\"Inputs\":\"[]\",\"Outputs\":\"[]\"},{\"ParamGuid\":\"08908df5-fa14-4982-9ab2-1aa0927566aa\",\"InstanceGuid\":\"dc0849be-e683-4828-af61-3bc86eeda406\",\"Name\":\"u\",\"NickName\":\"u\",\"Description\":\"No conversion\",\"TypeName\":\"Generic Data\",\"Optional\":true,\"Access\":\"item\",\"Mapping\":\"None\",\"Reverse\":false,\"Simplify\":false,\"Inputs\":\"[]\",\"Outputs\":\"[]\"}]")
# 通过字符串修改输入端、输出端
c_script = CSharpScript()  # -> out, a
# ---------- c_script: C# ----------
// GH_COMPONENT_IO_START
// INPUT_PARAMS: [{"ParamGuid":"08908df5-fa14-4982-9ab2-1aa0927566aa","InstanceGuid":"81f19b63-d1d4-46cb-a931-34492996e6b6","Name":"x","NickName":"x","Description":"No conversion","TypeName":"Generic Data","Optional":true,"Access":"item","Mapping":"None","Reverse":false,"Simplify":false,"Inputs":"[]","Outputs":"[]"},{"ParamGuid":"08908df5-fa14-4982-9ab2-1aa0927566aa","InstanceGuid":"d8c3b838-03a3-42fb-a280-9aef59a1db4c","Name":"y","NickName":"y","Description":"No conversion","TypeName":"Generic Data","Optional":true,"Access":"item","Mapping":"None","Reverse":false,"Simplify":false,"Inputs":"[]","Outputs":"[]"}]
// OUTPUT_PARAMS: [{"ParamGuid":"3ede854e-c753-40eb-84cb-b48008f14fd4","InstanceGuid":"ee8f82a5-b022-448b-9ce5-805c66279935","Name":"out","NickName":"out","Description":"Standard output and error contents collected during script run","TypeName":"Text","Optional":false,"Access":"item","Mapping":"None","Reverse":false,"Simplify":false,"Inputs":"[]","Outputs":"[\u0022bd8ea2a9-eabb-4c1d-b23c-8cd43031e2aa\u0022]"},{"ParamGuid":"08908df5-fa14-4982-9ab2-1aa0927566aa","InstanceGuid":"f3cf2a59-34ed-4984-93b8-c166f50609b1","Name":"a","NickName":"a","Description":"No conversion","TypeName":"Generic Data","Optional":false,"Access":"item","Mapping":"None","Reverse":false,"Simplify":false,"Inputs":"[]","Outputs":"[]"}]
// GH_COMPONENT_IO_END
// Grasshopper Script Instance
#region Usings
using System;
using System.Linq;
using System.Collections;
using System.Collections.Generic;
using System.Drawing;

using Rhino;
using Rhino.Geometry;

using Grasshopper;
using Grasshopper.Kernel;
using Grasshopper.Kernel.Data;
using Grasshopper.Kernel.Types;
#endregion

public class Script_Instance : GH_ScriptInstance
{
    #region Notes
    /* 
      Members:
        RhinoDoc RhinoDocument
        GH_Document GrasshopperDocument
        IGH_Component Component
        int Iteration

      Methods (Virtual & overridable):
        Print(string text)
        Print(string format, params object[] args)
        Reflect(object obj)
        Reflect(object obj, string method_name)
    */
    #endregion

    private void RunScript(object x, object y, object z, object u, ref object a)
    {
        // Write your logic here
        a = null;
    }
}
# ---------- end c_script ----------
# 通过代码修改输入端、输出端
c_script_2 = CSharpScript()  # -> out, a
# ---------- c_script_2: C# ----------
// GH_COMPONENT_IO_START
// INPUT_PARAMS: [{"ParamGuid":"08908df5-fa14-4982-9ab2-1aa0927566aa","InstanceGuid":"464db661-b61f-425b-b670-8154dff47ccf","Name":"x","NickName":"x","Description":"No conversion","TypeName":"Generic Data","Optional":true,"Access":"item","Mapping":"None","Reverse":false,"Simplify":false,"Inputs":"[]","Outputs":"[]"},{"ParamGuid":"08908df5-fa14-4982-9ab2-1aa0927566aa","InstanceGuid":"e6a253f8-f778-4eb4-9d22-d95505902565","Name":"y","NickName":"y","Description":"No conversion","TypeName":"Generic Data","Optional":true,"Access":"item","Mapping":"None","Reverse":false,"Simplify":false,"Inputs":"[]","Outputs":"[]"},{"ParamGuid":"08908df5-fa14-4982-9ab2-1aa0927566aa","InstanceGuid":"636c3c65-f4f5-488e-a33d-fa902cef1cec","Name":"z","NickName":"z","Description":"No conversion","TypeName":"Generic Data","Optional":true,"Access":"item","Mapping":"None","Reverse":false,"Simplify":false,"Inputs":"[]","Outputs":"[]"},{"ParamGuid":"08908df5-fa14-4982-9ab2-1aa0927566aa","InstanceGuid":"dc0849be-e683-4828-af61-3bc86eeda406","Name":"u","NickName":"u","Description":"No conversion","TypeName":"Generic Data","Optional":true,"Access":"item","Mapping":"None","Reverse":false,"Simplify":false,"Inputs":"[]","Outputs":"[]"}]
// OUTPUT_PARAMS: [{"ParamGuid":"3ede854e-c753-40eb-84cb-b48008f14fd4","InstanceGuid":"7ad1b6fa-ef90-4160-b5bd-e15b2496793d","Name":"out","NickName":"out","Description":"Standard output and error contents collected during script run","TypeName":"Text","Optional":false,"Access":"item","Mapping":"None","Reverse":false,"Simplify":false,"Inputs":"[]","Outputs":"[\u0022bd8ea2a9-eabb-4c1d-b23c-8cd43031e2aa\u0022]"},{"ParamGuid":"08908df5-fa14-4982-9ab2-1aa0927566aa","InstanceGuid":"0ed9ac1a-e4c4-40cc-8a51-39c576619024","Name":"a","NickName":"a","Description":"No conversion","TypeName":"Generic Data","Optional":false,"Access":"item","Mapping":"None","Reverse":false,"Simplify":false,"Inputs":"[]","Outputs":"[]"}]
// GH_COMPONENT_IO_END
// Grasshopper Script Instance
#region Usings
using System;
using System.Linq;
using System.Collections;
using System.Collections.Generic;
using System.Drawing;

using Rhino;
using Rhino.Geometry;

using Grasshopper;
using Grasshopper.Kernel;
using Grasshopper.Kernel.Data;
using Grasshopper.Kernel.Types;
#endregion

public class Script_Instance : GH_ScriptInstance
{
    #region Notes
    /* 
      Members:
        RhinoDoc RhinoDocument
        GH_Document GrasshopperDocument
        IGH_Component Component
        int Iteration

      Methods (Virtual & overridable):
        Print(string text)
        Print(string format, params object[] args)
        Reflect(object obj)
        Reflect(object obj, string method_name)
    */
    #endregion

    private void RunScript(object x, object y, object z, object u, ref object a)
    {
        // Write your logic here
        a = null;
    }
}
# ---------- end c_script_2 ----------
script = ScriptEditor(ScriptComponent=c_script.out, IntputParams=panel_2)  # -> Result, ComponentType, IsSDKMode, SourceCode, InputParams, OutputParams
script_2 = ScriptEditor(ScriptComponent=c_script_2.out, Code=panel)  # -> Result, ComponentType, IsSDKMode, SourceCode, InputParams, OutputParams
