# Grasshopper definition sever_test.gh (Grasshopper 1.0.8)
# plug-ins: GrasshopperSever

# 通过TCP执行相关命令
toggle = BooleanToggle(False)
# 通过TCP传入命令，执行后返回
toggle_2 = BooleanToggle(False)
panel = Panel("""using System.Text.Json;
using Grasshopper;
using GrasshopperSever.Utils;

public class Script_Instance : GH_ScriptInstance
{
    private void RunScript(ref object ljson)
    {
        string json = "{\"name\":\"张三\",\"age\":30}";
        using (var doc = JsonDocument.Parse(json)){
            JsonElement root = doc.RootElement.Clone();
            ljson = new Ljson("TEST", "TEST INFO", root);
        }
    }
}""")
server = GHServer(Enabled=toggle, Port="6698")  # -> Status, OutPut
receiver = GHReceiver(Enabled=toggle_2, Port="6700")  # -> Client, LJson, Status
panel_2 = Panel(server.OutPut)
actuator = GHActuator(LJson=receiver.LJson)  # -> Status, Result, OutPut
# 执行c#函数
cmdrhino = CommandRhino(Ljson=receiver.LJson)
runc = RunScript(Code=panel)  # -> Ljson, Out
sender = GHSender(Client=receiver.Client, LJson=actuator.Result)
# 发送rhino脚本
panel_3 = Panel(actuator.OutPut)
l2j = Ljson2Json(Ljson=runc.Ljson)
panel_4 = Panel(l2j)
